# Grasshopper definition ASSIGNMENT01.gh (Grasshopper 1.0.7)
# plug-ins: Kangaroo2 Components

bool = Boolean(Slider(0, range=0..1))
polygon_radius = GetInteger(Slider(12, range=1..20), AtLeast=1, AtMost=1, Maximum=2147483647, Minimum=-2147483648, TreeAccess=False)
polygon_sides = GetInteger(Slider(3, range=3..10), AtLeast=1, AtMost=1, Maximum=2147483647, Minimum=-2147483648, TreeAccess=False)
polygon_fillet = GetNumber(Slider(0, range=0..1), AtLeast=1, AtMost=1, Maximum=1.797693135e+308, Minimum=-1.797693135e+308, TreeAccess=False)
height_of_levels = GetInteger(Slider(10, range=0..10), AtLeast=1, AtMost=1, Maximum=2147483647, Minimum=-2147483648, TreeAccess=False)
number_of_levels = GetInteger(Slider(8, range=1..10), AtLeast=1, AtMost=1, Maximum=2147483647, Minimum=-2147483648, TreeAccess=False)
twist_amount = GetInteger(Slider(90, range=0..90), AtLeast=1, AtMost=1, Maximum=2147483647, Minimum=-2147483648, TreeAccess=False)
growth_rate = GetNumber(Slider(0.31, range=0.01..1), AtLeast=1, AtMost=1, Maximum=1.797693135e+308, Minimum=-1.797693135e+308, TreeAccess=False)
growth_direction = GetBoolean(bool, AtLeast=1, AtMost=1, FalseValue="False", TreeAccess=False, TrueValue="True")
pipe_amount = GetNumber(Slider(12, range=1..20), AtLeast=1, AtMost=1, Maximum=1.797693135e+308, Minimum=-1.797693135e+308, TreeAccess=False)
pipe_radius = GetNumber(Slider(0.48, range=0.01..1), AtLeast=1, AtMost=1, Maximum=1.797693135e+308, Minimum=-1.797693135e+308, TreeAccess=False)
pt = Point(Point(0, 0, 0))
polygon = Polygon(Plane=pt, Radius=polygon_radius, Segments=polygon_sides, FilletRadius=polygon_fillet)  # -> Polygon, Length
series = Series(Start=0, Step=height_of_levels, Count=number_of_levels)
series_2 = Series(Start="1", Step=1, Count=number_of_levels)
rad = Radians(Degrees=twist_amount)
Z = UnitZ(Factor=series)
move = Move(Geometry=polygon.Polygon, Motion=Z)  # -> Geometry, Transform
multiplication = Multiplication(A=series_2, B=rad)
multiplication_2 = Multiplication(A=series_2, B=growth_rate)
rev = ReverseList(List=multiplication_2)
filter = StreamFilter(Gate=growth_direction, Stream0=multiplication_2, Stream1=rev)
rotate = Rotate(Geometry=move.Geometry, Angle=multiplication, Plane=PlaneXY(0, 0, 0))  # -> Geometry, Transform
area = Area(Geometry=rotate.Geometry)  # -> Area, Centroid
scale = Scale(Geometry=rotate.Geometry, Center=area.Centroid, Factor=filter)  # -> Geometry, Transform
divide = DivideCurve(Curve=scale.Geometry, Count=pipe_amount, Kinks=False)  # -> Points, Tangents, Parameters
flip = FlipMatrix(Data=divide.Points)
intcrv = Interpolate(Vertices=flip, Degree=3, Periodic=False, KnotStyle=1)  # -> Curve, Length, Domain
merge = Merge(Data1=scale.Geometry, Data2=intcrv.Curve)  # -> flatten(Result)
mp = MultiPipe(Curves=merge, NodeSize=pipe_radius, EndOffset=1, StrutSize=1, Segment=0, KinkAngle=0.6, CubeFit=0, Caps=0)
output = Geometry(mp)
context_bake = ContextBake(TWISTED_GEOMETRY=output)
